# Grasshopper definition yarn_fiber_generation.gh (Grasshopper 1.0.7)

number_slider = Slider(4, range=0..10)
addition = Addition(A=number_slider, B=Slider(0.5, range=0..1))
pi = Pi(Factor=Slider(0.5, range=0..1))
python = GhPythonScript(
    nRows=Slider(2, range=0..10),
    nLoops=Slider(2, range=0..10),
    samplesPerLoop=Slider(64, range=0..100),
    nFibers=Slider(4, range=0..10),
    a=Slider(1.5, range=0..10),
    d=Slider(1, range=0..1),
    h=number_slider,
    w=addition,
    r=Slider(0.5, range=0..1),
    omega=Slider(5, range=0..10),
    phi=pi)  # -> out, plYarn, plFiber; inputs nRows: Int32, nLoops: Int32, samplesPerLoop: Int32, nFibers: Int32
# ---------- python: Python ----------
__author__ = "tianchen"

import rhinoscriptsyntax as rs

from math import sin, cos, sqrt, pow, pi

class Vector3:
    def __init__(self, x=0.0, y=0.0, z=0.0):
        self.x = x
        self.y = y
        self.z = z

def sqr(x):
    return x * x

def norm2(v):
    return sqr(v.x) + sqr(v.y) + sqr(v.z)

def norm(v):
    return sqrt(norm2(v))

def scale(c, v):
    cv = Vector3(c * v.x, c * v.y, c * v.z)
    return cv

def cross(u, v):
    w = Vector3()
    w.x = u.y * v.z - u.z * v.y
    w.y = u.z * v.x - u.x * v.z
    w.z = u.x * v.y - u.y * v.x
    return w

def yarnCurve(t, a, h, d):
    gamma_t = Vector3()
    gamma_t.x = t + a * sin(2.0 * t)
    gamma_t.y = h * cos(t)
    gamma_t.z = d * cos(2.0 * t)
    return gamma_t

def frenetFrame(t, a, h, d):
    e1 = Vector3()
    e2 = Vector3()

    u_t, v_t, x_t, y_t = 0.0, 0.0, 0.0, 0.0
    e1.x = 1.0 + 2.0 * a * cos(2.0 * t)
    e1.y = -h * sin(t)
    e1.z = -2.0 * d * sin(2.0 * t)
    u_t = norm2(e1)
    v_t = 2.0 * h * h * cos(t) * sin(t) + 16.0 * d * d * cos(2.0 * t) * sin(2.0 * t) - 8.0 * a * (1.0 + 2.0 * a * cos(2.0 * t)) * sin(2.0 * t)
    x_t = 1.0 / sqrt(u_t)
    y_t = v_t / (2.0 * pow(u_t, 3.0 / 2.0))
    e2.x = y_t * (-1.0 - 2.0 * a * cos(2.0 * t)) - x_t * 4.0 * a * sin(2.0 * t)
    e2.y = y_t * h * sin(t) - x_t * h * cos(t)
    e2.z = y_t * 2.0 * d * sin(2.0 * t) - x_t * 4.0 * d * cos(2.0 * t)
    e1 = scale(x_t, e1)
    e2 = scale(1.0 / norm(e2), e2)
    e3 = cross(e1, e2)
    return [e1, e2, e3]

def fiberCurve(t, a, h, d, r, omega, phi):
    gamma_t = yarnCurve(t, a, h, d)
    [e1, e2, e3] = frenetFrame(t, a, h, d)
    theta_t = t * omega - 2. * cos(t) + phi
    eta_t = Vector3(0, 0, 0)
    eta_t.x = gamma_t.x + r * (cos(theta_t) * e2.x + sin(theta_t) * e3.x)
    eta_t.y = gamma_t.y + r * (cos(theta_t) * e2.y + sin(theta_t) * e3.y)
    eta_t.z = gamma_t.z + r * (cos(theta_t) * e2.z + sin(theta_t) * e3.z)
    return eta_t



def writeYarnCurves(nRows, rowOffset, nLoops, samplesPerLoop, a, h, d):
    '''
    Input
        str filename       output filename 
        int nRows          number of rows in wale direction 
        dbl rowOffset      row spacing in wale direction 
        int nLoops         number of loops in course direction 
        int samplesPerLoop sample points for each loop 
        dbl a              loop roundness 
        dbl h              loop height 
        dbl d              loop depth 
    '''
    
    ptList = []
    plList = []
    
    nPoints = 0
    dt = 2*pi / samplesPerLoop

    # Write vertices
    for row in range(nRows):
        y0 = rowOffset * row
        for loop in range(nLoops):
            t0 = 2*pi * loop
            for sample in range(samplesPerLoop):
                t = t0 + dt * sample
                gamma_t = yarnCurve(t, a, h, d)

                ptList.append(rs.AddPoint([gamma_t.x, gamma_t.y + y0, gamma_t.z]))

    # Write polylines
    for row in range(nRows):
        pl = []
        for loop in range(nLoops):
            for sample in range(samplesPerLoop):
                pl.append(nPoints)
                nPoints += 1
        
        plList.append(rs.AddPolyline([ptList[pli] for pli in pl]))

    return [ptList, plList]

def writeFiberCurves(nRows, rowOffset, nLoops, samplesPerLoop, a, h, d, r, omega, nFibers):

    '''
    Input
        str filename       output filename 
        int nRows          number of rows in wale direction 
        dbl rowOffset      row spacing in wale direction 
        int nLoops         number of loops in course direction 
        int samplesPerLoop sample points for each loop 
        dbl a              loop roundness 
        dbl h              loop height 
        dbl d              loop depth 
        dbl r              yarn radius
        dbl omega          amount of fiber twist
        int nFibers        number of fibers around yarn
    '''
    
    
    ptList = []
    plList = []

    nPoints = 0
    dt = (2.0 * pi) / samplesPerLoop
    dphi = (2.0 * pi) / nFibers

    # write vertices
    for row in range(nRows):
        y0 = rowOffset * row
        for fiber in range(nFibers):
            phi = dphi * fiber
            for loop in range(nLoops):
                t0 = 2.0 * pi * loop
                for sample in range(samplesPerLoop):
                    t = t0 + dt * sample
                    eta_t = fiberCurve(t, a, h, d, r, omega, phi)
                    ptList.append(rs.AddPoint([eta_t.x, eta_t.y + y0, eta_t.z]))

    # write polylines
    for row in range(nRows):
        y0 = rowOffset * row
        for fiber in range(nFibers):
            pl=[]
            for loop in range(nLoops):
                for sample in range(samplesPerLoop):
                    pl.append(nPoints)
                    
                    nPoints += 1
            
            plList.append(rs.AddPolyline([ptList[pli] for pli in pl]))

    
    return [ptList, plList]
[ptYarn, plYarn] = writeYarnCurves(nRows, w, nLoops, samplesPerLoop, a, h, d)

[ptFiber, plFiber] = writeFiberCurves(nRows, w, nLoops, samplesPerLoop, a, h, d, r, omega, nFibers)
# ---------- end python ----------
crv = Curve(python.plFiber)
crv_2 = Curve(python.plYarn)
preview = CustomPreview(
    Geometry=crv_2,
    Material={diffuse=RGB(159, 161, 69), emission=RGB(48, 48, 21), shine=0.5, specular=RGB(255, 254, 254), transparency=0})
preview_2 = CustomPreview(
    Geometry=crv,
    Material={diffuse=RGB(86, 184, 204), emission=RGB(26, 55, 61), shine=0.5, specular=RGB(255, 254, 254), transparency=0})
